# Dynamo graph underground_pipes.dyn "topotest_v2" (Dynamo 2.5.0.7460)

select_model_elements = DSModelElementsSelection()  # 3 picked in the model

# group: select topo
select_model_element = DSModelElementSelection()  # 1 picked in the model

# group: get topo mesh
mesh = Topography.Mesh(topography=select_model_element)
vertexPositions = Mesh.VertexPositions(mesh=mesh)
faceIndices = Mesh.FaceIndices(mesh=mesh)
code_block = CodeBlock(ind=faceIndices) { [ ind.A, ind.B, ind.C ]; }
getItemAtIndex = List.GetItemAtIndex(list=vertexPositions, index=code_block)
transpose = List.Transpose(lists=getItemAtIndex)
byPerimeterPoints = Surface.ByPerimeterPoints(points=transpose)
byJoinedSurfaces = PolySurface.ByJoinedSurfaces(surfaces=byPerimeterPoints)

# group: ray trace
python_script = Python(IN[0]=select_model_elements, IN[1]=byJoinedSurfaces)
# ---------- python_script.python (73 lines) ----------
import clr

clr.AddReference('ProtoGeometry')
import Autodesk.DesignScript.Geometry as DS

clr.AddReference('RevitAPI')
from Autodesk.Revit.DB import *
from Autodesk.Revit.DB.Structure import *
from Autodesk.Revit.DB.Mechanical import *
from Autodesk.Revit.DB.Plumbing import *

clr.AddReference('RevitAPIUI')
from Autodesk.Revit.UI import *

clr.AddReference('System')
from System.Collections.Generic import List

clr.AddReference('RevitNodes')
import Revit
clr.ImportExtensions(Revit.GeometryConversion)
clr.ImportExtensions(Revit.Elements)

clr.AddReference('RevitServices')
import RevitServices
from RevitServices.Persistence import DocumentManager
from RevitServices.Transactions import TransactionManager

doc = DocumentManager.Instance.CurrentDBDocument
uidoc=DocumentManager.Instance.CurrentUIApplication.ActiveUIDocument


def CreateRays( mepEle ):
    mepLine = mepEle.GetLocation()

    pts = []

    for param in [ i* 0.05 for i in range(0,21) ] :
        pt = mepLine.PointAtParameter( param )
        pts.append( pt )
    
    rays = []
    for pt in pts:
        ray = DS.Line.ByStartPointDirectionLength( pt , DS.Vector.ZAxis(), 5000)
        rays.append( ray )

    return rays

def FindIntersects( rays, topoPolysrf ):
    intersects = []
    for ray in rays :
        inter = topoPolysrf.Intersect( ray )
        if len( inter ) > 0 :
            intersects.append( inter[0] )
        else:
            intersects.append( ray.StartPoint )
    return intersects


mepElements = IN[0]
topoPolysrf = IN[1]

TransactionManager.Instance.EnsureInTransaction(doc)

res = []
mepLines = []
for mepEle in mepElements:
    rays =  CreateRays(mepEle)
    intersects = FindIntersects( rays, topoPolysrf )
    res.append( intersects )

TransactionManager.Instance.TransactionTaskDone()

OUT = res
# ----------------------------------------

# group: chop into segments
python_script_2 = Python(IN[0]=python_script)
# ---------- python_script_2.python (32 lines) ----------
#!/usr/bin/python
# -*- coding: utf-8 -*-
import clr
import math
clr.AddReference('ProtoGeometry')
from Autodesk.DesignScript.Geometry import *

# Preparing input from Dynamo to Revit

ptLst = IN[0]
res = []

for pts in ptLst:
    master = []
    grp = [pts[0]]
    for i in range(len(pts) - 2):
        thisVec = Vector.ByTwoPoints(pts[i], pts[i + 1])
        nextVec = Vector.ByTwoPoints(pts[i + 1], pts[i + 2])
        angle = Vector.AngleWithVector(thisVec, nextVec)

        if angle < 3 and i != len(pts) - 3:
            grp.append(pts[i + 1])
        elif angle < 3 and i == len(pts) - 3:
            grp.append(pts[i + 1])
            grp.append(pts[i + 2])
            master.append(grp)
        else:
            grp.append(pts[i + 1])
            master.append(grp)
            grp = [pts[i + 1]]
    res.append(master)
OUT = res
# ----------------------------------------

# group: pipe lines
python_script_3 = Python(IN[0]=python_script_2, IN[1]=select_model_elements)
# ---------- python_script_3.python (46 lines) ----------
import clr

clr.AddReference('ProtoGeometry')
from Autodesk.DesignScript.Geometry import *

clr.AddReference('RevitAPI')
from Autodesk.Revit.DB import *
from Autodesk.Revit.DB.Structure import *
from Autodesk.Revit.DB.Mechanical import *
from Autodesk.Revit.DB.Plumbing import *

clr.AddReference('RevitAPIUI')
from Autodesk.Revit.UI import *

clr.AddReference('System')
from System.Collections.Generic import List

clr.AddReference('RevitNodes')
import Revit
clr.ImportExtensions(Revit.GeometryConversion)
clr.ImportExtensions(Revit.Elements)

clr.AddReference('RevitServices')
import RevitServices
from RevitServices.Persistence import DocumentManager
from RevitServices.Transactions import TransactionManager

doc = DocumentManager.Instance.CurrentDBDocument
uidoc=DocumentManager.Instance.CurrentUIApplication.ActiveUIDocument

segmentsLst = IN[0]
mepEles = (UnwrapElement(e) for e in IN[1])
TransactionManager.Instance.EnsureInTransaction(doc)

alignedPipes = []
for mepEle, segments in zip( mepEles, segmentsLst ):
	for seg in segments:
		p1 = seg[0]
		p2 = seg[-1]
		newpipe = Pipe.Create(doc, mepEle.MEPSystem.GetTypeId() , mepEle.GetTypeId() , mepEle.ReferenceLevel.Id, p1.ToXyz(), p2.ToXyz() )
		
		alignedPipes.append( newpipe )

TransactionManager.Instance.TransactionTaskDone()

OUT = alignedPipes
# ----------------------------------------
